% Simulink data dictionary ControllerModel.sldd

Controller = enum(DefaultValue="Normal")
  Normal = 0
  Climb = 1
  StallRecovery = 2

ALT_THRESHOLD = Simulink.Parameter(100, StorageClass="Const")  % 1.       ALT_THRESHOLD = 100 meters
STALL_SPEED = Simulink.Parameter(20, StorageClass="Const")  % 1.       STALL_SPEED = 20 m/s
PITCH_CMD_LIMIT = Simulink.Parameter(20, StorageClass="Const")  % 1.       PITCH_CMD_LIMIT = 20 degrees
GAIN = Simulink.Parameter(0.1, StorageClass="Const")  % 1.       GAIN = 0.1
CLIMB_PITCH_CMD = Simulink.Parameter(5, StorageClass="Const")  % 1.       CLIMB_PITCH_CMD = 5 degrees
THROTTLE_UP_RATE_LIMIT = Simulink.Parameter(10, StorageClass="Const")  % 1.       THROTTLE_UP_RATE_LIMIT = 10% per second (0.1 per frame)
PERSISTENCT = Simulink.Parameter(10, StorageClass="Const")  % 1.       PERSISTENCT = 100 (equivalent to 1 second with 10 msec execution rate)